# Grasshopper definition mold_simple.gh (Grasshopper 1.0.7)

# ---- group: Kaku-kaku
panel = Panel("""0,0,0
0,20,0
10,20,0
10,0,0
20,0,0
20,20,0
30,20,0
30,0,0
40,0,0""")
polyline = PolyLine(Vertices=panel, Closed=False)

# ---- group: Pentagon
polygon = Polygon(Plane=PlaneXY(0, 0, 0), Radius="25", Segments="5", FilletRadius=0)  # -> Polygon, Length

# ---- group: Love
curve = Curve(<curve referenced from the Rhino model>)
curve_2 = Curve(<curve referenced from the Rhino model>)
curve_3 = Curve(<curve referenced from the Rhino model>)
curve_4 = Curve(<curve referenced from the Rhino model>)

# ---- group: Zig-zag
pi = Pi(Factor="24")
range = Range(Domain=pi, Steps=Slider(150, range=0..1000))
expression = Expression(x=range, A=Slider(15, range=0..30), Expression="A*sin(x/6)")
construct_point = ConstructPoint(XCoordinate=range, YCoordinate=expression, ZCoordinate=0)
interpolate = Interpolate(Vertices=construct_point, Degree=3, Periodic=False, KnotStyle=1)  # -> Curve, Length, Domain

# ---- group: Heart
curve_5 = Curve(<curve referenced from the Rhino model>)
mirror = Mirror(Geometry=curve_5, Plane=PlaneYZ(0, 0, 0))  # -> Geometry, Transform
join_curves = JoinCurves(Curves=[curve_5, mirror.Geometry], Preserve=False)

# ----
curve_6 = Curve(<curve referenced from the Rhino model>)
r = Slider(1, range=0..3)
closed = Closed(Curve=curve_6)  # -> Closed, Periodic
stream_gate = StreamGate(Stream=curve_6, Gate=closed.Closed)  # -> Target0, Target1
closed_2 = Closed(curve=stream_gate.Target1, number=r)  # -> surface_6, surface_4, surface_5, curve_5, curve_6
open = Open(curve=stream_gate.Target0, number=r)  # -> surface_5, surface_6, surface_4
list_item = ListItem(List=closed_2.curve_5, Index=0, Wrap=True)
list_item_2 = ListItem(List=closed_2.curve_6, Index="1", Wrap=True)
panel_2 = Panel("""3.2
-3.2""")
panel_3 = Panel("""6
1""")
dashpattern = DashPattern(curve=stream_gate.Target0, pattern=panel_3, distance=panel_2)
panel_4 = Panel("""-2
5
4""")
panel_5 = Panel("""1.2
-0.2""")
panel_6 = Panel("""6
1""")
panel_7 = Panel("""-2
5
4""")
extrusionz = ExtrusionZ(base=flatten([open.surface_5, open.surface_6, open.surface_4]), factor=panel_7)
extrusionz_2 = ExtrusionZ(base=flatten([closed_2.surface_6, closed_2.surface_4, closed_2.surface_5]), factor=panel_4)
dashpattern_2 = DashPattern(curve=list_item, pattern=panel_6, distance=panel_5)
dashpattern_3 = DashPattern(curve=list_item_2, pattern=panel_6, distance=panel_5)
extrusionz_3 = ExtrusionZ(base=flatten(dashpattern), factor="4")
extrusionz_4 = ExtrusionZ(base=flatten([dashpattern_3, dashpattern_2]), factor="4")
solid_difference = SolidDifference(BrepsA=extrusionz_2, BrepsB=extrusionz_4)
solid_difference_2 = SolidDifference(BrepsA=extrusionz, BrepsB=extrusionz_3)

# ==== cluster ExtrusionZ
factor = ClusterInput()
unit_z = UnitZ(Factor=factor)
base = ClusterInput()
extrude = Extrude(Base=base, Direction=unit_z)
extrusion = ClusterOutput(extrude)

# ==== cluster DashPattern
curve = ClusterInput()
pattern = ClusterInput()
dash_pattern = DashPattern(Curve=curve, Pattern=pattern)  # -> Dashes, Gaps
distance = ClusterInput()
offset_curve_loose = OffsetCurveLoose(Curve=dash_pattern.Gaps, Distance=graft(distance))
flip_matrix = FlipMatrix(Data=offset_curve_loose)
loft = Loft(Curves=flip_matrix, Options={Adjust=False, Closed=False, LoftEnds=0, LoftSimp=0, LoftType=0, Rebuild=10, Refit=0.01})
brep = Brep(loft)
brep_2 = ClusterOutput(brep)

# ==== cluster Closed
number = ClusterInput()
curve = ClusterInput()
number_2 = Number(number)
curve_2 = Curve(curve)
negative = Negative(Value=number_2)
addition = Addition(A=number_2, B="1")
negative_2 = Negative(Value=addition)
addition_2 = Addition(A=number_2, B="4")
addition_3 = Addition(A=number_2, B="6")
offset_curve = OffsetCurve(Curve=curve_2, Plane=PlaneXY(0, 0, 0), Distance=addition_2, BothSides=addition_3, Kinks=0, CapType=1)
offset_curve_2 = OffsetCurve(Curve=curve_2, Plane=PlaneXY(0, 0, 0), Distance=number_2, BothSides=addition, Kinks=0, CapType=1)
offset_curve_3 = OffsetCurve(Curve=curve_2, Plane=PlaneXY(0, 0, 0), Distance=negative, BothSides=negative_2, Kinks=0, CapType=1)
list_item = ListItem(List=offset_curve, Index="1", Wrap=True)
boundary_surfaces = BoundarySurfaces(Edges=offset_curve)
boundary_surfaces_2 = BoundarySurfaces(Edges=[offset_curve_2, offset_curve_3])
boundary_surfaces_3 = BoundarySurfaces(Edges=list_item)
surface = Surface(boundary_surfaces)
curve_3 = Curve(offset_curve_2)
surface_2 = Surface(boundary_surfaces_2)
curve_4 = Curve(offset_curve_3)
surface_3 = Surface(boundary_surfaces_3)
surface_4 = ClusterOutput(surface)
curve_5 = ClusterOutput(curve_3)
surface_5 = ClusterOutput(surface_2)
curve_6 = ClusterOutput(curve_4)
surface_6 = ClusterOutput(surface_3)

# ==== cluster Open
number = ClusterInput()
number_2 = Number(number)
curve = ClusterInput()
negative = Negative(Value=number_2)
curve_2 = Curve(curve)
offset_curve = OffsetCurve(Curve=curve_2, Plane=PlaneXY(0, 0, 0), Distance=number_2, BothSides=negative, Kinks=0, CapType=1)
curve_3 = Curve(offset_curve)
offset_curve_2 = OffsetCurve(Curve=curve_3, Distance="6", Corners=1)
offset_curve_3 = OffsetCurve(Curve=curve_3, Distance="4", Corners=1)
offset_curve_4 = OffsetCurve(Curve=offset_curve, Distance="1", Corners=1)
curve_4 = Curve(offset_curve_2)
boundary_surfaces = BoundarySurfaces(Edges=flatten([offset_curve_4, offset_curve]))
boundary_surfaces_2 = BoundarySurfaces(Edges=flatten([offset_curve_3, curve_4]))
boundary_surfaces_3 = BoundarySurfaces(Edges=curve_4)  # -> flatten(Surfaces)
surface = Surface(boundary_surfaces)
surface_2 = Surface(boundary_surfaces_3)
surface_3 = Surface(boundary_surfaces_2)
surface_4 = ClusterOutput(surface)
surface_5 = ClusterOutput(surface_2)
surface_6 = ClusterOutput(surface_3)
